# Dynamo graph UpgradeFiles.dyn (Dynamo 1.0.0.1180)

# group: RFA Upgrade
files_to_upgrade = Directory("..")
path_to_save_files = Directory("..")
upgrade_rfas = Python(IN[0]=files_to_upgrade, IN[1]=path_to_save_files)
# ---------- upgrade_rfas.python (52 lines) ----------
import sys
sys.path.append("C:\Program Files (x86)\IronPython 2.7\Lib");
import os
import clr

clr.AddReference('ProtoGeometry')
clr.AddReference('RevitNodes')
clr.AddReference('RevitServices')
import RevitServices
from RevitServices.Persistence import DocumentManager

from Autodesk.DesignScript.Geometry import *
#The inputs to this node will be stored as a list in the IN variables.
dataEnteringNode = IN
a=[]
r=[]
app = DocumentManager.Instance.CurrentUIApplication.Application

for dir,subdirlist,files in os.walk(IN[0]):  
  for file in files:
    if file.endswith(".rfa"):
      f = str(dir + "\\" + file)
      a.append(f)
      d = app.OpenDocumentFile(f)
      subpath = ""      
      if len(subdirlist) == 0:
        subpath = IN[1] + "\\" + os.path.basename(dir) + "\\"
        if not os.path.exists(subpath):
          #create dir to be able to write to
          os.makedirs(subpath)
      else:
        subpath= IN[1] + "\\"

      newf = subpath + file
      d.SaveAs(newf)
      d.Close()
      r.append(newf)

#remove backups
for dir,subdirlist,files in os.walk(IN[1]):
  for file in files:
    if file.endswith(".0001.rfa"):
      ftd = dir + "\\" + file
      os.remove(ftd)

#test for success
res = False
if len(a) == len(r):
  res = True

#Assign your output to the OUT variable.
OUT = res
# ----------------------------------------
